# Dynamo graph Pile Mark Generation.dyn (Dynamo 2.1.0.7500)

# group: Input
bounding_box = DSModelElementSelection()  # nothing selected; graph input
categories = Categories("OST_StructuralFoundation")  # graph input
type_mark_pile_cap_prefix = StringInput("SPC")  # graph input
type_mark_pile = StringInput("FP")  # graph input
x_tolerance_in_mm = DoubleSlider(500, range=0..1000 step 5)  # graph input
y_tolerance_in_mm = DoubleSlider(500, range=0..1000 step 5)  # graph input
pile_naming_prefix = StringInput("SP")  # graph input
start_number = DoubleInput(1)  # graph input

# group: Find Piles and Pile Caps
all_elements_of_category = ElementsOfCategory(Category=categories)
elementType = Element.ElementType(element=all_elements_of_category)
code_block = CodeBlock { "Type Mark"; }
getParameterValueByName = Element.GetParameterValueByName(element=elementType, parameterName=code_block)
code_block_2 = CodeBlock(x=type_mark_pile_cap_prefix) { x + "#*"; }
python_script = Python(IN[0]=getParameterValueByName, IN[1]=code_block_2)
# ---------- python_script.python (17 lines) ----------
# Load the Python Standard and DesignScript Libraries
import sys
import clr
import re
clr.AddReference('ProtoGeometry')
from Autodesk.DesignScript.Geometry import *

# The inputs to this node will be stored as a list in the IN variables.
dataEnteringNode = IN
output = []

# Place your code below this line
for item in IN[0]:
	output.append(re.match(IN[1], item))

# Assign your output to the OUT variable.
OUT = output
# ----------------------------------------
isNull = Object.IsNull(obj=python_script)
code_block_3 = CodeBlock { null; }
if_ = If(test=isNull, true=code_block_3, false=all_elements_of_category)
code_block_4 = CodeBlock { false; }
clean = List.Clean(list=if_, preserveIndices=code_block_4)
python_script_2 = Python(IN[0]=getParameterValueByName, IN[1]=type_mark_pile)  # same code as python_script
isNull_2 = Object.IsNull(obj=python_script_2)
if_2 = If(test=isNull_2, true=code_block_3, false=all_elements_of_category)
clean_2 = List.Clean(list=if_2, preserveIndices=code_block_4)

# group: Filter Elements to those within Scope Box
boundingBox = Element.BoundingBox(element=bounding_box)
getLocation = Element.GetLocation(element=clean)
contains = BoundingBox.Contains(boundingBox=boundingBox, point=getLocation)
code_block_5 = CodeBlock { null; }
if_3 = If(test=contains, true=clean, false=code_block_5)
clean_3 = List.Clean(list=if_3, preserveIndices=code_block_4)
getLocation_2 = Element.GetLocation(element=clean_2)
contains_2 = BoundingBox.Contains(boundingBox=boundingBox, point=getLocation_2)
if_4 = If(test=contains_2, true=clean_2, false=code_block_5)
clean_4 = List.Clean(list=if_4, preserveIndices=code_block_4)

# group: Find Piles that Intersect Pilecaps
boundingBox_2 = Element.BoundingBox(element=clean_3)
getLocation_3 = Element.GetLocation(element=clean_4)
contains_3 = BoundingBox.Contains(boundingBox=boundingBox_2, point=getLocation_3, lacing=CrossProduct)
count = List.Count(list=clean_3)
ofRepeatedItem = List.OfRepeatedItem(item=clean_4, amount=count)
code_block_6 = CodeBlock { null; }
if_5 = If(test=contains_3, true=ofRepeatedItem, false=code_block_6)
clean_5 = List.Clean(list=if_5, preserveIndices=code_block_4)

# group: Sort Elements by Location
python_script_3 = Python(IN[0]=clean_3)
# ---------- python_script_3.python (13 lines) ----------
# Load the Python Standard and DesignScript Libraries
import sys
import clr
clr.AddReference('ProtoGeometry')
from Autodesk.DesignScript.Geometry import *

# The inputs to this node will be stored as a list in the IN variables.
dataEnteringNode = IN

# Place your code below this line

# Assign your output to the OUT variable.
OUT = [str(x) for x in range(len(IN[0]))]
# ----------------------------------------
getLocation_4 = Element.GetLocation(element=clean_3)
X = Point.X(point=getLocation_4)
code_block_7 = CodeBlock(x=X, y=x_tolerance_in_mm) { x/y; }
round = Math.Round(number=code_block_7)
Y = Point.Y(point=getLocation_4)
code_block_8 = CodeBlock(x=Y, y=y_tolerance_in_mm) { -1*x/y; }
round_2 = Math.Round(number=code_block_8)
round_3 = Math.Round(number=X)
code_block_9 = CodeBlock(x=Y) { -1*x; }
round_4 = Math.Round(number=code_block_9)
python_script_4 = Python(IN[0]=python_script_3, IN[1]=round, IN[2]=round_2, IN[3]=round_3, IN[4]=round_4)
# ---------- python_script_4.python (23 lines) ----------
# Load the Python Standard and DesignScript Libraries
import sys
import clr
clr.AddReference('ProtoGeometry')
from Autodesk.DesignScript.Geometry import *

# The inputs to this node will be stored as a list in the IN variables.
dataEnteringNode = IN

element_list = []

# Place your code below this line
for x in range(len(IN[0])):
	element_list.append((IN[2][x], IN[1][x], IN[0][x], IN[4][x], IN[3][x]))

s = sorted(element_list, key = lambda x: (x[0], x[1], x[3], x[4]))

output = []
for x in range(len(s)):
	output.append(int(s[x][2]))

# Assign your output to the OUT variable.
OUT = output
# ----------------------------------------
getItemAtIndex = List.GetItemAtIndex(list=clean_3, index=python_script_4)
indexOf = List.IndexOf(list=clean_3, element=getItemAtIndex)
getItemAtIndex_2 = List.GetItemAtIndex(list=clean_5, index=indexOf)

# group: Sort Piles within Pile Cap by Location
python_script_5 = Python(IN[0]=getItemAtIndex_2)
# ---------- python_script_5.python (13 lines) ----------
# Load the Python Standard and DesignScript Libraries
import sys
import clr
clr.AddReference('ProtoGeometry')
from Autodesk.DesignScript.Geometry import *

# The inputs to this node will be stored as a list in the IN variables.
dataEnteringNode = IN

# Place your code below this line

# Assign your output to the OUT variable.
OUT = [[str(x) for x in range(len(IN[0][i]))] for i in range(len(IN[0]))]
# ----------------------------------------
getLocation_5 = Element.GetLocation(element=getItemAtIndex_2)
X_2 = Point.X(point=getLocation_5)
round_5 = Math.Round(number=X_2)
Y_2 = Point.Y(point=getLocation_5)
code_block_10 = CodeBlock(x=Y_2) { -1*x; }
round_6 = Math.Round(number=code_block_10)
python_script_6 = Python(IN[0]=python_script_5, IN[1]=round_5, IN[2]=round_6)
# ---------- python_script_6.python (23 lines) ----------
# Load the Python Standard and DesignScript Libraries
import sys
import clr
clr.AddReference('ProtoGeometry')
from Autodesk.DesignScript.Geometry import *

# The inputs to this node will be stored as a list in the IN variables.
dataEnteringNode = IN

output = []

# Place your code below this line
for y in range(len(IN[0])):
	element_list = []
	for x in range(len(IN[0][y])):
		element_list.append((IN[2][y][x], IN[1][y][x], IN[0][y][x]))

	s = sorted(element_list, key = lambda x: (x[0], x[1]))

	output.append([int(s[i][2]) for i in range(len(element_list))])

# Assign your output to the OUT variable.
OUT = output
# ----------------------------------------
getItemAtIndex_3 = List.GetItemAtIndex(list=getItemAtIndex_2, index=python_script_6, lacing=Shortest)

# group: Set Pile Mark
code_block_11 = CodeBlock { "Mark"; }
python_script_7 = Python(IN[0]=getItemAtIndex_2, IN[1]=pile_naming_prefix, IN[2]=start_number)
# ---------- python_script_7.python (24 lines) ----------
# Load the Python Standard and DesignScript Libraries
import sys
import clr
import string
clr.AddReference('ProtoGeometry')
from Autodesk.DesignScript.Geometry import *

# The inputs to this node will be stored as a list in the IN variables.
dataEnteringNode = IN

# Place your code below this line
pile_nums = []
letters = string.ascii_lowercase

for i in range(len(IN[0])):
	if len(IN[0][i]) == 1:
		cap_num = IN[1] + str(i+IN[2])
		pile_nums.append([cap_num])
	else:
		cap_num = IN[1] + str(i+IN[2])
		pile_nums.append([cap_num + letters[x] for x in range(len(IN[0][i]))]) 

# Assign your output to the OUT variable.
OUT = pile_nums
# ----------------------------------------
setParameterByName = Element.SetParameterByName(element=getItemAtIndex_3, parameterName=code_block_11, value=python_script_7)

# group: Check Correct Number of Piles
count_2 = List.Count(list=clean_5, lacing=Longest)
elementType_2 = Element.ElementType(element=clean_3)
code_block_12 = CodeBlock { "No. of Piles"; }
getParameterValueByName_2 = Element.GetParameterValueByName(element=elementType_2, parameterName=code_block_12)
code_block_13 = CodeBlock(x=count_2, y=getParameterValueByName_2) { x == y; }
countFalse = List.CountFalse(list=code_block_13)
watch = Watch(countFalse)  # graph output
python_script_8 = Python(IN[0]=watch)
# ---------- python_script_8.python (12 lines) ----------
# Load the Python Standard and DesignScript Libraries
import sys
import clr
clr.AddReference('ProtoGeometry')
from Autodesk.DesignScript.Geometry import *

import clr
clr.AddReference('RevitAPIUI')
from Autodesk.Revit.UI import TaskDialog

if IN[0] > 0:
	TaskDialog.Show('Error', 'The number of piles found within a pilecap is greater than the \"No. of Piles\" parameter.\n\nPlease ensure that all element types have the correct number in this parameter and ensure that there are no overlapping or clashing piles')
# ----------------------------------------
